% Simulink data dictionary w2_4_1.sldd

J = Simulink.Parameter(3.2284e-6, DataType="double")
K = Simulink.Parameter(0.0274, DataType="double")
L = Simulink.Parameter(2.75e-6, DataType="double")
R = Simulink.Parameter(4, DataType="double")
b = Simulink.Parameter(3.5077e-6, DataType="double")